# Grasshopper definition parabola_project.gh (Grasshopper 1.0.7)

c_script = CSharpScript(x=Slider(8, range=0..10))  # -> out, A, B; inputs x: Double
# ---------- c_script: C# ----------
    A = -Math.Abs(x);
    B = 2 * (Math.Abs(x)) + 1;
# ---------- end c_script ----------
series = Series(Start=c_script.A, Step=1, Count=c_script.B)
sqr = Square(Value=series)
series_2 = Series(Start=sqr, Step=1, Count=10)
multiplication = Multiplication(A=series, B=Slider(95, range=0..100))
item = ListItem(List=series_2, Index=0, Wrap=True)
path_mapper = PathMapper(item, source="{A;B;C}", target="{A;B}")
pt = ConstructPoint(XCoordinate=multiplication, YCoordinate=path_mapper, ZCoordinate=0)
lng = ListLength(List=pt)
subtraction = Subtraction(A=lng, B=1)
intcrv = Interpolate(Vertices=pt, Degree=3, Periodic=False, KnotStyle=1)  # -> Curve, Length, Domain
item_2 = ListItem(List=pt, Index=0, Wrap=True)
item_3 = ListItem(List=pt, Index=subtraction, Wrap=True)
ln = Line(StartPoint=item_2, EndPoint=item_3)
Y = UnitY(Factor=Slider(63, range=0..100))
move = Move(Geometry=ln, Motion=Y)  # -> Geometry, Transform
revsrf = Revolution(Curve=intcrv.Curve, Axis=move.Geometry, Domain=Domain(3.141592654, 0))
divide = DivideDomain²(Domain=revsrf, UCount=Slider(1, range=0..100), VCount=Slider(25, range=0..100))
subsrf = Isotrim(Surface=revsrf, Domain=divide)
edges = BrepEdges(Brep=subsrf)  # -> Naked, Interior, NonManifold
midpt = CurveMiddle(Curve=edges.Naked)
cir = Circle(Plane=midpt, Radius=Slider(25, range=0..100))
project = Project(Curve=cir, Brep=revsrf, Direction=Vector(0, 0, 1))  # -> flatten(Curve)
srfsplit = SurfaceSplit(Surface=revsrf, Curves=project)
item_4 = ListItem(List=srfsplit, Index=Slider(76, range=0..100), Wrap=True)
Z = UnitZ(Factor=1)
extr = Extrude(Base=item_4, Direction=Z)
