# Grasshopper definition solar_path_main.gh (Grasshopper 1.0.7)

minutes = Slider(11, range=0..60)
degrees = Slider(43, range=0..89)
C = Count(13)
division = Division(A=minutes, B=60)
series = Series(Start=-90, Step=15, Count=C)
addition = Addition(A=degrees, B=division)
list = ValueList({"Equinox": 0, "Summer Solstice": 23.45, "Winter Solstice": -23.45}, selected="Equinox")
number_slider = Slider(69, range=0..100)
rad = Radians(Degrees=addition)
rad_2 = Radians(Degrees=series)
rad_3 = Radians(Degrees=list)
c_script = CSharpScript(r=number_slider, HRA=rad_2, LAT=rad, DEC=rad_3)  # -> out, rs, ds, ALT_values, dt, dh, rh; inputs r: Double, HRA: Double, LAT: Double, DEC: Double
# ---------- c_script: C# ----------
    /*Convert to degrees*/
    double cdg = (180 / Math.PI);

    double ALT = (Math.Asin((Math.Sin(DEC) * Math.Sin(LAT)) + (Math.Cos(DEC) * Math.Cos(LAT) * Math.Cos(HRA))));

    List<double> ALT_list = new List<double>();
    ALT_list.Add(ALT);

    List<double> ALT_list_corrected = new List<double>();
    foreach (double i in ALT_list)
    {
      ALT_list_corrected.Add(i * 1);
    }

    rs = r * Math.Cos(DEC) / (Math.Sin(ALT) + Math.Sin(DEC));
    ds = r * ((Math.Cos(LAT))) / (Math.Sin(LAT) + Math.Sin(DEC));
    ALT_values = ALT_list_corrected[0];
    dt = r * (Math.Tan(LAT));
    dh = r / (Math.Cos(LAT)) * Math.Tan(HRA);
    rh = r / (Math.Cos(LAT)) * Math.Sin(HRA);
# ---------- end c_script ----------
cir = Circle(Plane=PlaneXY(0, 0, 0), Radius=number_slider)
item = ListItem(List=c_script.ds, Index=0, Wrap=True)
cp = ControlPoints(Curve=cir)  # -> Points, Weights, Knots
darc = DeconstructArc(Arc=cir)  # -> BasePlane, Radius, Angle
panel = Panel(c_script.rs)
neg = Negative(Value=item)
item_2 = ListItem(List=cp.Points, Index=Slider(2, range=0..10), Wrap=True)
X = UnitX(Factor=c_script.dh)
pt = ConstructPoint(XCoordinate=darc.BasePlane, YCoordinate=neg, ZCoordinate=0)
move = Move(Geometry=item_2, Motion=X)  # -> Geometry, Transform
ln = Line(StartPoint=darc.BasePlane, EndPoint=pt)
arc = Arc(Plane=move.Geometry, Radius=1, Angle=Domain(0, 3.141592654))  # -> Arc, Length
circle = CircleCNR(Center=pt, Normal=Vector(0, 0, 1), Radius=c_script.rs)
circle_2 = Circle3Pt()  # -> Circle, Plane, Radius
trim = TrimWithRegion(Curve=circle, Region=cir)  # -> Inside, Outside
item_3 = ListItem(List=trim.Inside, Index=0, Wrap=True)
