# Grasshopper definition solar_path_reset.gh (Grasshopper 1.0.7)

series = Series(Start=-23.5, Step=23.5, Count=3)
number_slider = Slider(100, range=0..100)
P = Plane(PlaneXY(0, 0, 0))
c_script = CSharpScript(r=number_slider, LAT=Slider(44, range=-90..90), DEC=series)  # -> out, dh, ds, dt, rh, rs, hours; inputs r: Double, LAT: Double, DEC: list of Double
# ---------- c_script: C# ----------
    //Convert degree input to radians
    double cdr = (Math.PI / 180);


    //Create ALT list, add ALT values
    List<double> ALT = new List<double>();
    ALT.Add(90 - LAT - 23.45);
    ALT.Add(90);
    ALT.Add(90 - LAT + 23.45);

    //Create rs values
    double rs1 = (r * Math.Cos(DEC[0] * cdr)) / (Math.Sin(LAT * cdr) + Math.Sin(DEC[0] * cdr));
    double rs2 = (r * Math.Cos(DEC[1] * cdr)) / (Math.Sin(LAT * cdr) + Math.Sin(DEC[1] * cdr));
    double rs3 = (r * Math.Cos(DEC[2] * cdr)) / (Math.Sin(LAT * cdr) + Math.Sin(DEC[2] * cdr));
    //Add values to rs list
    List<double> rs_input = new List<double>();
    rs_input.Add(rs1);
    rs_input.Add(rs2);
    rs_input.Add(rs3);

    //Create ds values
    double ds1 = (r * (Math.Cos(LAT * cdr))) / (Math.Sin(LAT * cdr) + Math.Sin(DEC[0] * cdr));
    double ds2 = (r * Math.Cos(LAT * cdr)) / (Math.Sin(LAT * cdr) + Math.Sin(DEC[1] * cdr));
    double ds3 = (r * (Math.Cos(LAT * cdr))) / (Math.Sin(LAT * cdr) + Math.Sin(DEC[2] * cdr));
    //Add values to ds list
    List<double> ds_input = new List<double>();
    ds_input.Add(ds1);
    ds_input.Add(ds2);
    ds_input.Add(ds3);


    //Create dt
    double dt_input = (r * Math.Tan(LAT * cdr));

    //Create HRA values
    List<int> HRA = new List<int>();
    int i = 15;
    for(i = -90; i <= 90; i += 15)
    {
      HRA.Add(i);
    }

    //Create dh
    List<double> dh_input = new List<double>();
    foreach (double hour in HRA)
    {
      {
        double dh_values = r / (Math.Cos(LAT * cdr) * Math.Tan(hour * cdr));
        dh_input.Add(dh_values);
      }
    }

    //dh_input.Remove(double.PositiveInfinity);
    //dh_input.Add(0);
    //dh_input.Sort();

    //Create rh
    List<double> rh_input = new List<double>();
    foreach (double hour in HRA)
    {
      double rh_values = r / ((Math.Cos(LAT * cdr)) * (Math.Sin(hour * cdr)));
      rh_input.Add(rh_values);
    }

    //rh_input.Remove(double.PositiveInfinity);
    //rh_input.Sort();


    ds = ds_input;
    rs = rs_input;
    dh = dh_input;
    rh = rh_input;
    dt = dt_input;
    hours = HRA;
# ---------- end c_script ----------
c_script_2 = CSharpScript(x=c_script.hours)  # -> out, A; inputs x: Double
# ---------- c_script_2: C# ----------
    A = 100 / (Math.Cos(-28 * (Math.PI/180)) * Math.Tan(x * (Math.PI/180)));
# ---------- end c_script_2 ----------
Y = UnitY(Factor=c_script.ds)
base_circle = Circle(Plane=P, Radius=number_slider)
circle = CircleCNR(Center=P, Normal=Vector(0, 0, 1), Radius=c_script.rs)
len = Length(Curve=base_circle)
pt = ConstructPoint(XCoordinate=c_script.dh, YCoordinate=0, ZCoordinate=0)
Y_2 = UnitY(Factor=c_script.dt)
dec_lines = Move(Geometry=circle, Motion=Y)  # -> Geometry, Transform
division = Division(A=len, B=360)
neg = Negative(Value=c_script.dt)
move = Move(Geometry=pt, Motion=Y_2)  # -> Geometry, Transform
divlength = DivideLength(Curve=base_circle, Length=division)  # -> Points, Tangents, Parameters
Y_3 = UnitY(Factor=neg)
panel = Panel(c_script.hours)
circle_2 = CircleCNR(Center=move.Geometry, Normal=Vector(0, 0, 1), Radius=c_script.rh)
multiplication = Multiplication(A=Y_3, B=2)
cull_i = CullIndex(List=dec_lines.Geometry, Indices=1, Wrap=True)
hr_lines = Move(Geometry=circle_2, Motion=multiplication)  # -> Geometry, Transform
bbx = BrepBrep(BrepA=base_circle, BrepB=hr_lines.Geometry)  # -> Curves, Points
devec = DeconstructVector(Vector=bbx.Curves)  # -> XComponent, YComponent, ZComponent
bbx_2 = BrepBrep(BrepA=base_circle, BrepB=dec_lines.Geometry)  # -> Curves, Points
panel_2 = Panel(hr_lines.Geometry)
panel_3 = Panel(devec.ZComponent)
ccx = CurveCurve()  # -> Points, ParamsA, ParamsB
shatter = Shatter(Parameters=ccx.Points)
